# Grasshopper definition TestFile.gh (Grasshopper 1.0.4)
# plug-ins: CurvedCreaseFolding

rectangle = Rectangle(Plane=PlaneXY(0, 0, 0), XSize="0 to 10", YSize="0 to 10", Radius=0)  # -> Rectangle, Length
number_slider = Slider(10, range=0..10)

# ---- group: Flat mesh
mplane = MeshPlane(Boundary=rectangle.Rectangle, WidthCount=number_slider, HeightCount=number_slider)  # -> Mesh, Area
crv_1 = Curve(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)
crv_2 = Curve(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)

# ---- group: Flat Mesh
mesh = Mesh(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)
crv = Curve([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])

# ---- group: 3D mesh
mesh_2 = Mesh(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)

# ----
crv_3 = Curve(flatten([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]))
mesh_3 = Mesh(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)
mesh_4 = Mesh(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)

mesh_5 = Mesh(mplane.Mesh)
crv_4 = Curve(crv_2)
crvcrsfld = CurvedCreaseFolding(Mesh=mesh_5, MeshSubdivision=Slider(0, range=0..3), FoldCurves=crv_4, Angle=Slider(1, range=0..6.283))  # -> Mesh3D, FoldingEdges, Mesh2D, FoldCurves, BoundaryCurves, GaussianCurvature, KineticEnergy
panel = Panel(crvcrsfld.KineticEnergy)
_3d_mesh = Mesh(crvcrsfld.Mesh3D)

bnd = Bounds(Numbers=crvcrsfld.GaussianCurvature)
clamping_pi_factor = Slider(0.5, range=0.001..0.5)
dedomain = DeconstructDomain(Domain=bnd)  # -> Start, End
abs = Absolute(Value=dedomain.Start)
abs_2 = Absolute(Value=dedomain.End)
max = Maximum(A=abs, B=abs_2)
pi = Pi(Factor=clamping_pi_factor)
min = Minimum(A=max, B=pi)
multiplication = Multiplication(A=min, B="1.01")
neg = Negative(Value=multiplication)
dom = ConstructDomain(DomainStart=neg, DomainEnd=multiplication)
remap = RemapNumbers(Value=crvcrsfld.GaussianCurvature, Source=dom, Target=Domain(0, 1))  # -> Mapped, Clipped
gradient = Gradient(
    LowerLimit=0,
    UpperLimit=1,
    Parameter=remap.Clipped,
    stops=[0: RGB(148, 0, 211), 0: RGB(220, 20, 60), 0: RGB(170, 162, 175), 0.001: RGB(148, 0, 211), 0.5: RGB(0, 255, 127), 0.999: RGB(255, 160, 122)])
nullrep = ReplaceNulls(Items=gradient, Replacements=ColourSwatch(SwatchColor=RGB(0, 255, 127)))  # -> Items, Count
mcol = MeshColours(Mesh=_3d_mesh, Colours=nullrep.Items)
tolerance = Number(min)

_2d_mesh = Mesh(crvcrsfld.Mesh2D)
area = Area(Geometry=_3d_mesh)  # -> Area, Centroid
area_2 = Area(Geometry=_2d_mesh)  # -> Area, Centroid
join = JoinCurves(Curves=crvcrsfld.FoldingEdges, Preserve=False)
vec2pt = Vector2Pt(PointA=area_2.Centroid, PointB=area.Centroid, Unitize=False)  # -> Vector, Length

bbox = BoundingBox(Content=_3d_mesh, Plane=PlaneXY(0, 0, 0))  # -> Box, Box_2
debox = DeconstructBox(Box=bbox.Box)  # -> Plane, X, Y, Z
X = UnitX(Factor=debox.X)
multiplication_2 = Multiplication(A=X, B=Slider(1.5, range=0..10))
addition = Addition(A=multiplication_2, B=vec2pt.Vector)
move = Move(Geometry=_2d_mesh, Motion=addition)  # -> Geometry, Transform

move_2 = Move(Geometry=crvcrsfld.FoldCurves, Motion=addition)  # -> Geometry, Transform
pipe = Pipe(Curve=move_2.Geometry, Radius=Slider(0.1, range=0..0.2), Caps=1)  # -> flatten(Pipe)

move_3 = Move(Geometry=crvcrsfld.BoundaryCurves, Motion=addition)  # -> Geometry, Transform
pipe_2 = Pipe(Curve=move_3.Geometry, Radius=Slider(0.1, range=0..0.2), Caps=1)  # -> flatten(Pipe)

material = CreateMaterial(
    Diffuse=ColourSwatch(SwatchColor=RGB(0, 76, 70)),
    Specular=RGB(255, 255, 255),
    Emission=ColourSwatch(SwatchColor=RGB(0, 255, 234)),
    Transparency=Slider(0, range=0..1),
    Shine=Slider(0, range=0..100))
pipe_3 = Pipe(Curve=join, Radius=Slider(0.1, range=0..0.2), Caps=1)

preview = CustomPreview(Geometry=mcol, Material=material)
preview_2 = CustomPreview(Geometry=move.Geometry, Material=material)
preview_3 = CustomPreview(Geometry=pipe_3, Material=ColourSwatch(SwatchColor=RGB(0, 0, 255)))
preview_4 = CustomPreview(Geometry=pipe, Material=ColourSwatch(SwatchColor=RGB(255, 0, 42)))
preview_5 = CustomPreview(Geometry=pipe_2, Material=ColourSwatch(SwatchColor=RGB(128, 0, 255)))

panel_2 = Panel(tolerance)
